# Grasshopper definition ESP-32WS.gh (Grasshopper 1.0.7)

trigger = Trigger(Interval=20, TimerInterval=20, Target=websocket_client_sender)
websocket_client_start = WebsocketClientStart(Address="ws://192.168.247.106/ws", InitalMessage="Hello World", Reset=Button())
websocket_client_sender = WebsocketClientSender(WebsocketObjects=websocket_client_start, Message="Hiiiiiiiyee")
websocket_client_receiver = WebsocketClientReceiver(WebsocketObjects=websocket_client_start, AutoUpdate=True)  # -> Message, Status
python = GhPythonScript(TEXT=websocket_client_receiver.Message)  # -> out, HEIGHT, RAD
# ---------- python: Python ----------
import json

sensors = json.loads(TEXT)
PTR = int(sensors['s1'])
PTR0 = int(sensors['s0'])

RAD = PTR0
if PTR > 2048:
    HEIGHT = PTR
else:
    HEIGHT = -PTR
# ---------- end python ----------
panel = Panel(websocket_client_receiver.Message)
panel_2 = Panel(python.RAD)
panel_3 = Panel(python.HEIGHT)
Z = UnitZ(Factor=python.HEIGHT)
cir = Circle(Plane=PlaneXY(0, 0, 0), Radius=python.RAD)
extr = Extrude(Base=cir, Direction=Z)
